# Grasshopper definition pile cap with 2 piles.gh (Grasshopper 1.0.7)
# plug-ins: Pufferfish

dist_between_piles_l_d = Slider(3, range=0..10)
embutimento = Slider(100, range=0..1000)
spacing_hor_stir = Slider(45, range=0..100)
nb_rebars = Slider(2, range=0..10)
cover = Slider(40, range=0..100)
pile_length = Slider(400, range=0..10000)
number_slider = Slider(100, range=0..1000)
diameter = Multiplication(A=number_slider, B=2)
dist_between_piles_l_d_2 = Panel(dist_between_piles_l_d)

# ---- group: 2-pile cap
subtraction = Subtraction(A=pile_length, B=embutimento)
length = Evaluate(F="(y+1)*(2*x)+200", x=number_slider, y=dist_between_piles_l_d_2)
width = Evaluate(F="x*2", x=number_slider)
eval = Evaluate(F="-(x+0*50)", x=number_slider)
eval_2 = Evaluate(F="-(x+100)", x=number_slider)
pt = ConstructPoint(XCoordinate=eval_2, YCoordinate=eval, ZCoordinate=subtraction)
rectangle = Rectangle(Plane=PlaneXY(0, 0, 0), XSize=length, YSize=width, Radius=0)  # -> Rectangle, Length
eval_3 = Evaluate(F="3*x+y*0", x=number_slider, y=embutimento)
height = ConstructPoint(XCoordinate=0, YCoordinate=0, ZCoordinate=eval_3)
addition = Addition(A=pt, B=height)
ln = Line(StartPoint=pt, EndPoint=addition)
extrcrv = ExtrudeAlong(Base=ln, Curve=rectangle.Rectangle)
cap = CapHoles(Brep=extrcrv)  # -> flatten(Brep)
volume = Volume(Geometry=cap)  # -> Volume, Centroid

# ----
height_2 = Slider(200, range=0..1000)
depth = Slider(200, range=0..1000)
width_2 = Slider(200, range=0..1000)

# ---- group: caps
pt_2 = Point(Point(0, 0, 0))
circle = CircleCNR(Center=pt_2, Normal=Vector(0, 0, 1), Radius=number_slider)
pt_3 = ConstructPoint(XCoordinate=0, YCoordinate=0, ZCoordinate=pile_length)
multiplication = Multiplication(A=diameter, B=dist_between_piles_l_d_2)
extr = Extrude(Base=circle, Direction=pt_3)
pt_4 = ConstructPoint(XCoordinate=multiplication, YCoordinate=0, ZCoordinate=0)
cap_2 = CapHoles(Brep=extr)
move = Move(Geometry=cap_2, Motion=pt_4)  # -> Geometry, Transform

# ----
vec = Vector("50,75,100")

# ---- group: rebars
spacing = Evaluate(Expression="-(X-150)/(y-1)", x=diameter, y=nb_rebars)
series = Series(Start=0, Step=spacing, Count=nb_rebars)
subtraction_2 = Subtraction(A=length, B="100")
pt_5 = Point(Point(1, 0, 0))
addition_2 = Addition(A=pt, B=vec)
rebar = LineSDL(Start=addition_2, Direction=pt_5, Length=subtraction_2)
offset = OffsetCurve(Curve=rebar, Distance=series, Plane=PlaneXY(0, 0, 0), Corners=1)

# ----
pt_6 = Point(Point(0, 0, 200))
division = Division(A=height, B="2")
move_2 = Move(Geometry=circle, Motion=pt_6)  # -> Geometry, Transform
pt_7 = Point(Point(0, 0, 1))
addition_3 = Addition(A=division, B=volume.Centroid)
multiplication_2 = Multiplication(A=height_2, B=pt_7)

# ---- group: RC column
rectangle_2 = Rectangle(Plane=PlaneXY(0, 0, 0), XSize=width_2, YSize=depth, Radius=0)  # -> Rectangle, Length
area = Area(Geometry=rectangle_2.Rectangle)  # -> Area, Centroid
vec2pt = Vector2Pt(PointA=area.Centroid, PointB=addition_3, Unitize=False)  # -> Vector, Length
move_3 = Move(Geometry=rectangle_2.Rectangle, Motion=vec2pt.Vector)  # -> Geometry, Transform
extr_2 = Extrude(Base=move_3.Geometry, Direction=multiplication_2)

# ----
nb_ver_stirrups = Slider(6, range=0..50)
cover_column = Slider(20, range=0..100)
nb_stirrups = Slider(11, range=0..100)
join = BrepJoin(Breps=[cap_2, move.Geometry])  # -> flatten(Breps), Closed
column = CapHoles(Brep=extr_2)

# ---- group: column stirrups
get_number = GetNumber(multiplication_2, AtLeast=1, AtMost=2147483647, Maximum=1.797693135e+308, Minimum=-1.797693135e+308)
spacing_2 = Evaluate(F="-(y-x)/(z-1)", x=cover_column, y=get_number, z=nb_stirrups)
stirrup_spacing = Panel(spacing_2)
neg = Negative(Value=cover_column)
series_2 = Series(Start=0, Step=spacing_2, Count=nb_stirrups)
offset_2 = OffsetCurve(Curve=move_3.Geometry, Distance=neg, Plane=PlaneXY(0, 0, 0), Corners=1)
yz = YZPlane(Origin=Point(0, 0, 0))
offset_3 = OffsetCurve(Curve=offset_2, Distance=series_2, Plane=yz, Corners=1)  # -> flatten(Curve)
subtraction_3 = Subtraction(A=nb_stirrups, B="1")

# ----
sdiff = SolidDifference(BrepsA=cap, BrepsB=join.Breps)
spacing_transv_rebars = Slider(50, range=0..100)
cover_2 = Slider(30, range=0..100)

# ---- group: Column rebars
item = ListItem(List=offset_3, Index=subtraction_3, Wrap=True)
box_corners = BoxCorners(Box=item)  # -> CornerA, CornerB, CornerC, CornerD, CornerE, CornerF, CornerG, CornerH
pdecon = Deconstruct(Point=box_corners.CornerA)  # -> XComponent, YComponent, ZComponent
vec_2 = VectorXYZ(XComponent=pdecon.XComponent, YComponent=pdecon.YComponent, ZComponent=pile_length)  # -> Vector, Length
ln_2 = Line(StartPoint=box_corners.CornerA, EndPoint=vec_2.Vector)
move2pt = MoveToPoint(Geometry=ln_2, PointA=box_corners.CornerA, PointB=box_corners.CornerB)  # -> Moved, Vector, Transform
move2pt_2 = MoveToPoint(Geometry=ln_2, PointA=box_corners.CornerA, PointB=box_corners.CornerC)  # -> Moved, Vector, Transform
move2pt_3 = MoveToPoint(Geometry=ln_2, PointA=box_corners.CornerA, PointB=box_corners.CornerD)  # -> Moved, Vector, Transform

# ---- group: piles transv. rebars
neg_2 = Negative(Value=cover_2)
nb_stirrups_2 = Evaluate(F="x/y", x=pile_length, y=spacing_transv_rebars)
round = Round(Number=nb_stirrups_2)  # -> Nearest, Floor, Ceiling
multiplication_3 = Multiplication(A=diameter, B=dist_between_piles_l_d_2)
pt_8 = Point(Point(0, 0, 1))
series_3 = Series(Start=0, Step=spacing_transv_rebars, Count=round.Floor)
pt_9 = Point(Point(0, 0, 1))
offset_4 = OffsetCurve(Curve=circle, Distance=neg_2, Plane=PlaneXY(0, 0, 0), Corners=1)
multiplication_4 = Multiplication(A=cover_2, B=pt_8)
xz = XZPlane(Origin=Point(0, 0, 0))
vec_3 = VectorXYZ(XComponent=multiplication_3, YComponent=0, ZComponent=0)  # -> Vector, Length
multiplication_5 = Multiplication(A=pt_9, B=pile_length)
move_4 = Move(Geometry=offset_4, Motion=multiplication_4)  # -> Geometry, Transform
offset_5 = OffsetCurve(Curve=move_4.Geometry, Distance=series_3, Plane=xz, Corners=1)  # -> flatten(Curve)
addition_4 = Addition(A=multiplication_5, B=vec_3.Vector)
move2pt_4 = MoveToPoint(Geometry=offset_5, PointA=multiplication_5, PointB=addition_4)  # -> Moved, Vector, Transform

# ----
long_rebars = Slider(4, range=0..10)

# ---- group: piles long. rebars
divide = DivideCurve(Curve=move_4.Geometry, Count=long_rebars, Kinks=False)  # -> Points, Tangents, Parameters
subtraction_4 = Subtraction(A=nb_stirrups_2, B="1")
item_2 = ListItem(List=offset_5, Index=subtraction_4, Wrap=True)
divide_2 = DivideCurve(Curve=item_2, Count=long_rebars, Kinks=False)  # -> Points, Tangents, Parameters
ln_3 = Line(StartPoint=divide.Points, EndPoint=divide_2.Points)
move2pt_5 = MoveToPoint(Geometry=ln_3, PointA=multiplication_5, PointB=addition_4)  # -> Moved, Vector, Transform

# ----
rc_pile_cap = Group(Objects=[column, join.Breps, sdiff])
piles_rebars = Group(Objects=[offset_5, move2pt_4.Moved, move2pt_5.Moved, ln_3])
column_rebars = Group(Objects=[move2pt.Moved, move2pt_2.Moved, move2pt_3.Moved, offset_3, ln_2])

# ---- group: horizontal stirrups
get_number_2 = GetNumber(height, AtLeast=1, AtMost=2147483647, Maximum=1.797693135e+308, Minimum=-1.797693135e+308)
panel = Panel("2")
neg_3 = Negative(Value=spacing_hor_stir)
neg_4 = Negative(Value=cover)
nb_stirrups_3 = Evaluate(F="(x-2*50)/y+1", x=get_number_2, y=spacing_hor_stir)
round_2 = Round(Number=nb_stirrups_3)  # -> Nearest, Floor, Ceiling
offset_6 = OffsetCurve(Curve=rectangle.Rectangle, Distance=neg_4, Plane=PlaneXY(0, 0, 0), Corners=1)
series_4 = Series(Start=0, Step=neg_3, Count=round_2.Floor)
lng = ListLength(List=series_4)
area_2 = Area(Geometry=offset_6)  # -> Area, Centroid
subtraction_5 = Subtraction(A=lng, B="1")
item_3 = ListItem(List=series_4, Index=subtraction_5, Wrap=True)
xz_2 = XZPlane(Origin=Point(0, 0, 0))
abs = Absolute(Value=item_3)

# ----
division_2 = Division(A=dist_between_piles_l_d_2, B=panel)

# ---- group: horizontal stirrups (continued)
multiplication_6 = Multiplication(A=diameter, B=division_2)
pt_10 = ConstructPoint(XCoordinate=multiplication_6, YCoordinate=0, ZCoordinate=pile_length)
vec2pt_2 = Vector2Pt(PointA=area_2.Centroid, PointB=pt_10, Unitize=False)  # -> Vector, Length
hor_stirrup = Move(Geometry=offset_6, Motion=vec2pt_2.Vector)  # -> Geometry, Transform
offset_7 = OffsetCurve(Curve=hor_stirrup.Geometry, Distance=series_4, Plane=xz_2, Corners=1)

# ---- group: vertical stirrups
dim = Dimensions(Surface=hor_stirrup.Geometry)  # -> UDimension, VDimension
box_corners_2 = BoxCorners(Box=hor_stirrup.Geometry)  # -> CornerA, CornerB, CornerC, CornerD, CornerE, CornerF, CornerG, CornerH
yz_2 = YZPlane(Origin=Point(0, 0, 0))
ver_spacing = Evaluate(F="y/(x-1)", x=nb_ver_stirrups, y=dim.UDimension)
rectangle_3 = Rectangle(Plane=yz_2, XSize=dim.VDimension, YSize=abs, Radius=0)  # -> Rectangle, Length
spacing_3 = Panel(ver_spacing)
series_5 = Series(Start=0, Step=ver_spacing, Count=nb_ver_stirrups)
move_5 = Move(Geometry=rectangle_3.Rectangle, Motion=box_corners_2.CornerA)  # -> Geometry, Transform
offset_8 = OffsetCurve(Curve=move_5.Geometry, Distance=series_5, Plane=PlaneXY(0, 0, 0), Corners=1)

# ----
pile_cap_rebars = Group(Objects=[offset_8, offset_7, offset])
